# Grasshopper definition Plate.gh (Grasshopper 1.0.8)
# plug-ins: GuitarForm

ubso = Slider(30, range=0..100)
lbso = Slider(40, range=0..100)
ubr = Slider(100, range=0..200)
lbr = Slider(120, range=0..200)
ubw = Slider(280, range=0..1000)
ubo = Slider(5, range=0..50)
lbo = Slider(10, range=0..50)
lbw = Slider(380, range=0..1000)
wr = Slider(60, range=0..200)
L = Slider(600, range=0..1000)
ww = Slider(240, range=0..1000)
wo = Slider(300, range=0..1000)
hw = Slider(56, range=0..100)
plate = Plate(
    BodyLength=L,
    UpperBoutWidth=ubw,
    UpperBoutOffset=ubo,
    UpperBoutPrimaryRadius=ubr,
    UpperBoutSecondaryOffset=ubso,
    WaistRadius=wr,
    WaistWidth=ww,
    WaistOffset=wo,
    LowerBoutWidth=lbw,
    LowerBoutOffset=lbo,
    LowerBoutPrimaryRadius=lbr,
    LowerBoutSecondaryOffset=lbso,
    HeelWidth=hw)  # -> ConstructionLines, OutlineRadii, OutlineArcs, OutlineLines
